# Grasshopper definition Reykjavik_Iceland_SimulationModel_Script.gh (Grasshopper 1.0.7)
# plug-ins: Eddy3D, DIVA Daylight

# ----
# Create Wind Directions
number_slider = Slider(24, range=0..100)
series = Series(Start="0", Step="15", Count=number_slider)
panel = Panel(series)

# ----
# Geometry &
# Boundary Conditions
path = FilePath("C:\Users\rsm278\Downloads\ISL_HO_Reykjavik.041300_TMYx.epw")
cluster = Cluster_2()
uniform_flow = UniformFlow(WindDirections=panel, ReferenceVelocity_m_s=5, SurfaceRoughnessHeight_m=1, Epw=path)
geo = Geometry(<mesh referenced from the Rhino model>)

# ----
# Simulation Domain
number_slider_2 = Slider(1200, range=0..10000)
domaincyl = CylindricalDomain(
    Geometry=cluster,
    Terrain=geo,
    BoundaryCondition=uniform_flow,
    BlockSize="20",
    SizeOfOuterRadius=number_slider_2,
    Height=Slider(325, range=0..1000))  # -> Domain, Mesh
cell_size = CellSize(SimulationDomain=domaincyl.Domain, BlockSize="20", DesiredCellSize=Slider(1, range=0..1))

# ----
# Mesh & Simulation
panel_2 = Panel("2500")
panel_3 = Panel("C:\ReykjavikStudioModelSnapSimpleNoLayersModelv2")
mset = MeshSettings(AccBuilding=cell_size, AccFeatures=cell_size, AccBBox=0, AccGround=cell_size, MiscSettings=1, NumberOfLayers=4, Mode=1)
rset = RunSettings(
    NumberOfIterations=panel_2,
    WriteInterval=20,
    NumberOfTimestepsToKeep=3,
    TurbulenceModel=1,
    RelaxationFactors=3,
    SolutionAndAlgorithmControl=1,
    PotentialFoamInitialization=False,
    AgeOfAir=False,
    NumberOfCPUs="10",
    OperatingSystem=0)
simulation = Simulation(
    SimulationDomain=domaincyl.Domain,
    WorkingDirectory=panel_3,
    MeshSettings=mset,
    RunSettings=rset,
    RunMeshing=Button(),
    MakeTrees=False,
    RunSimulation=Button(),
    runWithBlueCFD=True)
residuals = Residuals(Result=simulation, SelectionOfWindDirections=panel, X=":", Y=":", Version=1, Run=Button(), visResiduals=False)

# ----
# Probing points & probing
pt = Point([<point referenced from the Rhino model> x730])
probing = Probing(BuildingMesh=cluster, Points=pt)
probing_2 = Probing(Result=simulation, ProbingPoints=probing, NameOfField=0, Run=Button())  # -> PorbingPoints, ProbingResult

# ----
# Clean Folders
button = Button()
clean = Clean(Directory=panel_3, Mode=2, Run=button)

# ----
# Paraview
# Grasshopper
# Wind vectors
points = Data(probing_2.PorbingPoints)
vectors = Data(probing_2.ProbingResult)
cluster_2 = Cluster(data=vectors)  # -> S, E, data_3
paraview = Paraview(Result=simulation, ParaviewVersion=2, Run=Button())
gradient = Gradient(
    LowerLimit=cluster_2.S,
    UpperLimit=Slider(5, range=0..10),
    Parameter=cluster_2.data_3,
    stops=[0.103: RGB(0, 0, 255), 0.22: RGB(0, 170, 255), 0.305: RGB(0, 255, 255), 0.398: RGB(0, 255, 188), 0.504: RGB(0, 255, 106), 0.605: RGB(91, 255, 0), 0.699: RGB(184, 255, 0), 0.799: RGB(255, 255, 0), 0.898: RGB(255, 170, 0)])
vdisex = VectorDisplayEx(Point=points, Vector=vectors, Colour=gradient, Width=Slider(2, range=0..10))

# ----
# MRT
# UTCI
# UTCI Scale
button_2 = Button()
mean_radiant_temperature = MeanRadiantTemperature(SimulationResult=simulation, ProbingPoints=probing_2.PorbingPoints, SimulationMode=0, Run=button_2)
hoy = HourOfYear(Month=Slider(1, range=0..12), Day=Slider(15, range=1..31), Hour=Slider(9, range=0..24))  # -> HourOfYear, DayOfYear
very_strong_heat_stress = ColourSwatch(SwatchColor=RGB(215, 48, 39))
very_strong_cold_stress = ColourSwatch(SwatchColor=RGB(69, 117, 180))
moderate_heat_stress = ColourSwatch(SwatchColor=RGB(253, 174, 97))
moderate_cold_stress = ColourSwatch(SwatchColor=RGB(171, 217, 238))
extreme_heat_stress = ColourSwatch(SwatchColor=RGB(165, 0, 38))
extreme_cold_stress = ColourSwatch(SwatchColor=RGB(40, 54, 149))
strong_heat_stress = ColourSwatch(SwatchColor=RGB(244, 109, 67))
strong_cold_stress = ColourSwatch(SwatchColor=RGB(116, 173, 209))
no_thermal_stress = ColourSwatch(SwatchColor=RGB(255, 255, 191))
slight_heat_stress = ColourSwatch(SwatchColor=RGB(254, 224, 144))
slight_cold_stress = ColourSwatch(SwatchColor=RGB(224, 243, 248))
panel_4 = Panel("-40")
merge = Merge(
    Data1=extreme_heat_stress,
    Data2=very_strong_heat_stress,
    Data3=strong_heat_stress,
    Data4=moderate_heat_stress,
    Data5=slight_heat_stress,
    Data6=no_thermal_stress,
    Data7=slight_cold_stress,
    Data8=moderate_cold_stress,
    Data9=strong_cold_stress,
    Data10=very_strong_cold_stress)
rev = ReverseList(List=merge)

# ----
# Wind Factors
button_3 = Button()
wind_factors = WindFactors(
    Result=simulation,
    ProbingPoints=probing_2.PorbingPoints,
    WindVelocity=probing_2.ProbingResult,
    Run=button_3,
    Interpolation=False)  # -> WindFactorsSpatial, WindFactorsAnnual
wind_comfort = AnnualWindComfort(WindFactorsAnnual=wind_factors.WindFactorsAnnual, WindComfortIndex=4)
cluster_3 = Cluster(data=wind_comfort)  # -> S, E, data_3
gradient_2 = Gradient(
    LowerLimit=cluster_3.S,
    UpperLimit=cluster_3.E,
    Parameter=cluster_3.data_3,
    stops=[0.103: RGB(0, 0, 128), 0.2: RGB(0, 0, 255), 0.305: RGB(192, 255, 255), 0.398: RGB(0, 255, 255), 0.504: RGB(128, 255, 128), 0.6: RGB(0, 192, 0), 0.699: RGB(255, 255, 192), 0.799: RGB(255, 255, 0), 0.898: RGB(255, 170, 0)])  # disabled
cluster_4 = Cluster_3(C=probing_2.PorbingPoints, R=Slider(1, range=0..10))
preview = CustomPreview(Geometry=cluster_4, Material=gradient_2)

outdoor_thermal_comfort = OutdoorThermalComfort(
    SimulationResult=simulation,
    ProbingPoints=probing_2.PorbingPoints,
    WindFactorsAnnual=wind_factors.WindFactorsAnnual,
    MeanRadiantTemperature=mean_radiant_temperature,
    Run=Button())  # -> UniversalThermalClimateIndexCObject, ComfortableHours
dedata = DeconstructData(In=outdoor_thermal_comfort.UniversalThermalClimateIndexCObject, Hours=hoy.HourOfYear)
cluster_5 = Cluster_4(D=dedata)  # -> flatten(am)
cluster_6 = Cluster(data=cluster_5)  # -> S, E, data_3
gradient_3 = Gradient(
    LowerLimit=0,
    UpperLimit=1,
    Parameter=cluster_6.data_3,
    stops=[0.103: RGB(0, 0, 128), 0.2: RGB(0, 0, 255), 0.305: RGB(192, 255, 255), 0.398: RGB(0, 255, 255), 0.504: RGB(128, 255, 128), 0.6: RGB(0, 192, 0), 0.699: RGB(255, 255, 192), 0.799: RGB(255, 255, 0), 0.898: RGB(255, 170, 0)])
item = ListItem(List=rev, Index=cluster_6.data_3, Wrap=True)
rev_2 = ReverseList(List=gradient_3)

preview_2 = CustomPreview(Geometry=cluster_4, Material=item)

# ==== cluster Cluster
data = ClusterInput()
data_2 = Data(data)
data_3 = ClusterOutput(data_2)
bnd = Bounds(Numbers=data_2)
dedomain = DeconstructDomain(Domain=bnd)  # -> Start, End
S = ClusterOutput(dedomain.Start)
E = ClusterOutput(dedomain.End)

# ==== cluster Cluster_2
geo = Geometry([<brep referenced from the Rhino model> x97, <mesh referenced from the Rhino model>])
mesh = Mesh(geo)
mjoin = MeshJoin(Meshes=mesh)
M = ClusterOutput(mjoin)

# ==== cluster Cluster_3
C = ClusterInput()
R = ClusterInput()
circle = CircleCNR(Center=C, Normal=Vector(0, 0, 1), Radius=R)
srf = Surface(circle)
srf_2 = ClusterOutput(srf)

# ==== cluster Cluster_4
D = ClusterInput()
flip = FlipMatrix(Data=D)
avr = Average(Input=flip)
am = ClusterOutput(avr)
